# Dynamo graph DownloadData5.dyn (Dynamo 2.19.3.6394)

string = StringInput("C:\\ProgramData\\Autodesk\\RVT 2024\\Libraries\\Russian\\Russia")
string_2 = StringInput("D:\\RevitData")
string_3 = StringInput("DXF")
python_script = Python(IN[0]=string, IN[1]=string_2, IN[2]=string_3)  # CPython3
# ---------- python_script.python (161 lines) ----------
"""
Dynamo Python Script: Конвертация RFA → DWG/DXF с сохранением структуры папок
"""

import clr
import sys
import os
from System.IO import Directory, Path, File
import System
from System.Collections.Generic import List

# Подключение библиотек
clr.AddReference('ProtoGeometry')
from Autodesk.DesignScript.Geometry import *

clr.AddReference('RevitAPI')
clr.AddReference('RevitAPIUI')
from Autodesk.Revit.DB import *

clr.AddReference('RevitServices')
from RevitServices.Persistence import DocumentManager

# ===== ВХОДНЫЕ ДАННЫЕ =====
input_folder = IN[0] if len(IN) > 0 else None
output_folder = IN[1] if len(IN) > 1 else None
export_format = (IN[2] if len(IN) > 2 else "DWG").upper().strip()

# ===== ПРОВЕРКА ВХОДНЫХ ДАННЫХ =====
if not input_folder or not Directory.Exists(input_folder):
    OUT = "❌ Ошибка: Укажите существующую папку с RFA файлами (параметр 1)"
    quit()

if not output_folder:
    output_folder = Path.Combine(Path.GetDirectoryName(input_folder), "Export_" + Path.GetFileName(input_folder))

if export_format not in ["DWG", "DXF"]:
    OUT = "❌ Ошибка: Формат должен быть DWG или DXF (параметр 3)"
    quit()

file_ext = ".dwg" if export_format == "DWG" else ".dxf"

# ===== ПОЛУЧЕНИЕ ДОСТУПА К REVIT =====
try:
    doc_manager = DocumentManager.Instance
    source_doc = doc_manager.CurrentDBDocument
    app = source_doc.Application
except Exception as e:
    OUT = f"❌ Ошибка подключения к Revit: {str(e)}"
    quit()

# ===== НАСТРОЙКА ЭКСПОРТА =====
if export_format == "DWG":
    export_opts = DWGExportOptions()
    export_opts.NamingConvention = DWGNamingConvention.LayerName
else:
    export_opts = DXFExportOptions()

# ===== ПОИСК ВСЕХ .RFA ФАЙЛОВ =====
rfa_files = []
for root, dirs, files in os.walk(input_folder):
    for file in files:
        if file.lower().endswith('.rfa'):
            rfa_files.append(Path.Combine(root, file))

if not rfa_files:
    OUT = f"⚠ Файлы .rfa не найдены в: {input_folder}"
    quit()

# ===== ОБРАБОТКА ФАЙЛОВ =====
results = []
success_count = 0
error_count = 0

for i, rfa_path in enumerate(rfa_files, 1):
    file_name = Path.GetFileNameWithoutExtension(rfa_path)
    family_doc = None
    
    try:
        print(f"[{i}/{len(rfa_files)}] Обработка: {file_name}")
        
        # 🔑 КЛЮЧЕВОЙ МОМЕНТ: вычисляем относительный путь
        rel_path = os.path.relpath(rfa_path, input_folder)
        # Убираем расширение для имени выходного файла
        rel_path_no_ext = os.path.splitext(rel_path)[0]
        
        # Создаём такую же структуру папок в output_folder
        target_subfolder = Path.Combine(output_folder, os.path.dirname(rel_path))
        if not Directory.Exists(target_subfolder):
            Directory.CreateDirectory(target_subfolder)
        
        # Открываем семейство
        family_doc = app.OpenDocumentFile(rfa_path)
        
        # Ищем 3D вид
        view3d = None
        collector = FilteredElementCollector(family_doc).OfClass(View3D)
        for v in collector:
            if not v.IsTemplate:
                view3d = v
                break
        
        if not view3d:
            results.append(f"⚠ {rel_path}: Нет 3D вида")
            continue
        
        # Экспорт в целевую подпапку
        view_ids = List[ElementId]()
        view_ids.Add(view3d.Id)
        
        # Экспортируем с базовым именем (без пути)
        base_name = os.path.basename(rel_path_no_ext)
        family_doc.Export(target_subfolder, base_name, view_ids, export_opts)
        
        # Попытка переименовать, если имя файла ≠ имя семейства
        expected_file = Path.Combine(target_subfolder, base_name + file_ext)
        if not File.Exists(expected_file):
            view_name_clean = "".join(c for c in view3d.Name if c not in r'<>:"/\|?*')
            alt_file = Path.Combine(target_subfolder, view_name_clean + file_ext)
            if File.Exists(alt_file):
                try:
                    File.Move(alt_file, expected_file)
                except:
                    pass
        
        success_count += 1
        results.append(f"✅ {rel_path}")
        
    except Exception as e:
        error_count += 1
        error_msg = str(e).replace('\n', ' ')[:100]
        results.append(f"❌ {os.path.relpath(rfa_path, input_folder)}: {error_msg}")
        
    finally:
        if family_doc is not None:
            try:
                family_doc.Close(False)
            except:
                pass

# ===== СОХРАНЕНИЕ ОТЧЕТА =====
report_path = Path.Combine(output_folder, "_export_report.txt")
with open(report_path, 'w', encoding='utf-8') as f:
    f.write(f"ОТЧЕТ: RFA → {export_format} (с сохранением структуры)\n")
    f.write(f"Дата: {System.DateTime.Now}\n")
    f.write(f"Источник: {input_folder}\n")
    f.write(f"Назначение: {output_folder}\n")
    f.write(f"Всего: {len(rfa_files)} | Успешно: {success_count} | Ошибок: {error_count}\n")
    f.write("-" * 60 + "\n")
    for r in results:
        f.write(r + "\n")

# ===== ВЫВОД =====
OUT = f"""🎯 Конвертация завершена!

📊 Статистика:
• Всего файлов: {len(rfa_files)}
• Успешно: {success_count}
• Ошибок: {error_count}

📁 Структура папок сохранена в: {output_folder}
📄 Отчет: {report_path}"""
# ----------------------------------------
watch = Watch(python_script)
