# Dynamo graph DownloadData6.dyn (Dynamo 2.19.3.6394)

directory_path = Directory("D:\RevitData\TrainFromBase")
python_script = Python(IN[0]=directory_path)  # CPython3
# ---------- python_script.python (231 lines) ----------
import clr
clr.AddReference('RevitAPI')
clr.AddReference('RevitAPIUI')
clr.AddReference('RevitNodes')
clr.AddReference('RevitServices')

from Autodesk.Revit.DB import *
from Autodesk.Revit.UI import *
from System.Collections.Generic import List
import os

try:
    doc = __revit__.ActiveUIDocument.Document
except:
    from RevitServices.Persistence import DocumentManager
    doc = DocumentManager.Instance.CurrentDBDocument

dir_path = IN[0]
if not dir_path or not os.path.isdir(dir_path):
    OUT = "❌ Укажите существующую папку"
else:
    report = []
    stats = {"fam_ok": 0, "sys_ok": 0, "err": 0}
    
    vft_3d = None
    for ft in FilteredElementCollector(doc).OfClass(ViewFamilyType):
        if ft.ViewFamily == ViewFamily.ThreeDimensional:
            vft_3d = ft
            break

    if vft_3d is None:
        OUT = "❌ В проекте нет типа 3D вида!"
    else:
        dxf_opts = DXFExportOptions()

        # ==========================================
        # ЧАСТЬ 1: Загружаемые семейства
        # ==========================================
        families = FilteredElementCollector(doc).OfClass(Family).ToElements()
        for fam in families:
            try:
                if not fam.IsEditable: continue
                safe_name = "".join(c for c in fam.Name if c not in r'<>:"/\|?*').strip() or "Fam_" + str(fam.Id.IntegerValue)
                fam_doc = doc.EditFamily(fam)
                if fam_doc is None: continue

                view_for_export = None
                for v in FilteredElementCollector(fam_doc).OfClass(View):
                    if v.ViewType == ViewType.ThreeD and not v.IsTemplate:
                        view_for_export = v; break

                if view_for_export is None:
                    t = Transaction(fam_doc, "Temp3D")
                    t.Start()
                    try:
                        view_for_export = View3D.CreateIsometric(fam_doc, vft_3d.Id)
                        t.Commit()
                    except: t.RollBack()

                if view_for_export:
                    fam_doc.Export(dir_path, safe_name, List[ElementId]([view_for_export.Id]), dxf_opts)
                    stats["fam_ok"] += 1
                fam_doc.Close(False)
            except: pass

        # ==========================================
        # ЧАСТЬ 2: Системные семейства
        # ==========================================
        target_cats_int = [
            int(BuiltInCategory.OST_Walls), int(BuiltInCategory.OST_Floors),
            int(BuiltInCategory.OST_Roofs), int(BuiltInCategory.OST_Ceilings),
            int(BuiltInCategory.OST_Topography), int(BuiltInCategory.OST_StructuralColumns),
            int(BuiltInCategory.OST_Columns), int(BuiltInCategory.OST_StructuralFraming)
        ]

        # Собираем все элементы и группируем по категориям
        all_sys_elements = []
        cat_ids_map = {}
        
        for e in FilteredElementCollector(doc).WhereElementIsNotElementType():
            cat = e.Category
            if cat and cat.Id.IntegerValue in target_cats_int:
                all_sys_elements.append(e)
                c_int = cat.Id.IntegerValue
                if c_int not in cat_ids_map: cat_ids_map[c_int] = List[ElementId]()
                cat_ids_map[c_int].Add(e.Id)
                
        report.append("📊 Найдено целевых экземпляров: {}".format(len(all_sys_elements)))

        # Кэшируем IDs всех модельных категорий
        all_model_cat_ids = []
        for cat in doc.Settings.Categories:
            try:
                if cat.CategoryType == CategoryType.Model:
                    all_model_cat_ids.append(cat.Id)
            except: pass

        # Список аннотационных категорий для скрытия
        annotation_cats_to_hide = [
            BuiltInCategory.OST_Dimensions,
            BuiltInCategory.OST_TextNotes,
            BuiltInCategory.OST_GenericAnnotation,
            BuiltInCategory.OST_Grids,
            BuiltInCategory.OST_Levels,
            BuiltInCategory.OST_SpotElevations,
            BuiltInCategory.OST_SpotCoordinates,
            BuiltInCategory.OST_Sections,
            BuiltInCategory.OST_Callouts,
            BuiltInCategory.OST_DetailComponents,
            BuiltInCategory.OST_Lines,
            BuiltInCategory.OST_ReferenceLines,
            BuiltInCategory.OST_SketchLines,
            BuiltInCategory.OST_Areas,
            BuiltInCategory.OST_Rooms,
            BuiltInCategory.OST_Cameras,
            BuiltInCategory.OST_Furniture,
            BuiltInCategory.OST_FurnitureSystems,
            BuiltInCategory.OST_PlumbingFixtures,
            BuiltInCategory.OST_MechanicalEquipment,
            BuiltInCategory.OST_ElectricalEquipment,
            BuiltInCategory.OST_SpecialityEquipment,
            BuiltInCategory.OST_Casework,
            BuiltInCategory.OST_Entourage,
            BuiltInCategory.OST_Roads,
            BuiltInCategory.OST_Site,
            BuiltInCategory.OST_Parking,
            BuiltInCategory.OST_Planting,
            BuiltInCategory.OST_Railings,
            BuiltInCategory.OST_Stairs,
            BuiltInCategory.OST_StairsSupports,
            BuiltInCategory.OST_StairsLandings,
            BuiltInCategory.OST_Ramps
        ]
        
        annotation_cat_ids = [ElementId(int(cat)) for cat in annotation_cats_to_hide]

        # ЦИКЛ ЭКСПОРТА
        for elem in all_sys_elements:
            temp_view = None
            tx = None
            try:
                cat_name = elem.Category.Name
                type_name = "Unknown"
                try:
                    # Получаем имя типа системного семейства
                    type_id = elem.GetTypeId()
                    if type_id != ElementId.InvalidElementId:
                        type_elem = doc.GetElement(type_id)
                        if type_elem:
                            type_name = type_elem.Name
                            # Если имя пустое, пробуем через параметр
                            if not type_name or type_name == "":
                                type_param = type_elem.LookupParameter("Type")
                                if type_param:
                                    type_name = type_param.AsString()
                except:
                    pass
                
                # Если не получилось, используем ID типа
                if not type_name or type_name == "Unknown" or type_name == "":
                    try:
                        type_id = elem.GetTypeId()
                        if type_id != ElementId.InvalidElementId:
                            type_name = "Type_" + str(type_id.IntegerValue)
                    except:
                        pass

                # 🔥 ИМЯ ФАЙЛА БЕЗ ID ЭЛЕМЕНТА
                safe_name = "".join(c for c in (cat_name + "_" + type_name) if c not in r'<>:"/\|?*').strip()

                tx = Transaction(doc, "Setup_" + str(elem.Id))
                tx.Start()
                
                temp_view = View3D.CreateIsometric(doc, vft_3d.Id)
                temp_view.Name = "Temp_" + str(elem.Id)
                temp_view.DetailLevel = ViewDetailLevel.Fine
                temp_view.CropBoxActive = False
                temp_view.CropBoxVisible = False

                # Скрываем ВСЕ аннотации
                for cat_id in annotation_cat_ids:
                    try: temp_view.SetCategoryHidden(cat_id, True)
                    except: pass

                # Скрываем ВСЕ модельные категории
                for cat_id in all_model_cat_ids:
                    try: temp_view.SetCategoryHidden(cat_id, True)
                    except: pass

                # Включаем ТОЛЬКО категорию целевого элемента
                target_cat_id = elem.Category.Id
                try: temp_view.SetCategoryHidden(target_cat_id, False)
                except: pass

                # Скрываем ВСЕ элементы этой категории
                all_ids_in_cat = cat_ids_map[target_cat_id.IntegerValue]
                temp_view.HideElements(all_ids_in_cat)

                # Показываем ТОЛЬКО один целевой элемент
                temp_view.UnhideElements(List[ElementId]([elem.Id]))
                
                tx.Commit()

                # Экспорт
                doc.Export(dir_path, safe_name, List[ElementId]([temp_view.Id]), dxf_opts)
                stats["sys_ok"] += 1

            except Exception as ex:
                if tx and tx.HasStarted():
                    try: tx.RollBack()
                    except: pass
                report.append("❌ Ошибка {}: {}".format(elem.Id, str(ex)[:80]))
                stats["err"] += 1
            finally:
                if temp_view:
                    try:
                        tx2 = Transaction(doc, "Del_" + str(elem.Id))
                        tx2.Start()
                        doc.Delete(temp_view.Id)
                        tx2.Commit()
                    except: pass

        summary = [
            "="*50,
            " СТАТИСТИКА:",
            " ✅ Загружаемые семейства: {}".format(stats["fam_ok"]),
            " ✅ Системные объекты: {}".format(stats["sys_ok"]),
            "  Ошибок: {}".format(stats["err"]),
            "="*50
        ]
        OUT = summary + report
# ----------------------------------------
watch = Watch(python_script)
