# Dynamo graph DownloadData7.dyn (Dynamo 2.19.3.6394)

family_types = FamilyTypes()  # nothing selected
view_family_types = ViewFamilyTypes()  # nothing selected
all_elements_of_category = ElementsOfCategory(Category=view_family_types)
