# Dynamo graph GenerateRevit.dyn (Dynamo 2.16.0)
# Генерация 3D элементов Revit из JSON команд пайплайна парсинга DXF

python_script = Python()  # unwired: IN[0]
# ---------- python_script.python (247 lines) ----------
# GenerateRevit.dyn
# Читает JSON из папки revit_commands и создаёт элементы в Revit
# IN[0]: путь к папке с JSON файлами
# IN[1]: имя уровня (default: 'Level 1')

import clr, os, json, math
clr.AddReference('RevitAPI')
clr.AddReference('RevitAPIUI')
clr.AddReference('RevitServices')

from Autodesk.Revit.DB import *
from Autodesk.Revit.DB.Structure import StructuralType
from RevitServices.Persistence import DocumentManager
from RevitServices.Transactions import TransactionManager

doc   = DocumentManager.Instance.CurrentDBDocument
uidoc = DocumentManager.Instance.CurrentUIApplication.ActiveUIDocument

# --- Входные данные ---
json_folder = str(IN[0]) if IN[0] else ''
level_name  = str(IN[1]) if len(IN) > 1 and IN[1] else 'Level 1'

if not os.path.isdir(json_folder):
    OUT = f'ERROR: Папка не найдена: {json_folder}'
    raise Exception(OUT)

json_files = [f for f in os.listdir(json_folder)
              if f.endswith('_revit_commands.json')]
if not json_files:
    OUT = f'ERROR: JSON файлы не найдены в {json_folder}'
    raise Exception(OUT)

# --- Вспомогательные функции ---

def get_level(name):
    levels = FilteredElementCollector(doc).OfClass(Level).ToElements()
    for lvl in levels:
        if lvl.Name == name:
            return lvl
    return list(levels)[0] if levels else None


def find_wall_type(thickness_ft):
    """Ищет тип стены ближайший по толщине."""
    collector = FilteredElementCollector(doc).OfClass(WallType).ToElements()
    best, best_diff = None, float('inf')
    for wt in collector:
        try:
            t = wt.get_Parameter(BuiltInParameter.WALL_ATTR_WIDTH_PARAM)
            if t:
                diff = abs(t.AsDouble() - thickness_ft)
                if diff < best_diff:
                    best_diff = diff
                    best = wt
        except:
            pass
    return best


def find_family_symbol(category_bic):
    """Ищет первый активный FamilySymbol нужной категории."""
    collector = (FilteredElementCollector(doc)
                 .OfClass(FamilySymbol)
                 .OfCategory(category_bic)
                 .ToElements())
    for sym in collector:
        if sym and sym.IsActive:
            return sym
    for sym in collector:
        if sym:
            sym.Activate()
            doc.Regenerate()
            return sym
    return None


def xyz(pt):
    if pt is None or len(pt) < 2:
        return XYZ(0, 0, 0)
    return XYZ(pt[0], pt[1], pt[2] if len(pt) > 2 else 0.0)


def make_wall(cmd, level):
    geom   = cmd['geometry']
    params = cmd.get('params', {})
    start  = geom['start']
    end    = geom['end']

    dx = end[0] - start[0]
    dy = end[1] - start[1]
    if math.sqrt(dx*dx + dy*dy) < 0.01:  # короче 0.01 фута = 3мм
        return None

    line   = Line.CreateBound(xyz(start), xyz(end))
    height = params.get('height_ft', 9.84252)  # 3м в футах
    thick  = params.get('thickness_ft', 0.65617)  # 200мм в футах

    # Ищем подходящий тип стены
    wall_type = find_wall_type(thick)

    if wall_type:
        wall = Wall.Create(doc, line, wall_type.Id, level.Id, height, 0.0, False, False)
    else:
        wall = Wall.Create(doc, line, level.Id, False)
        # Устанавливаем высоту
        try:
            p = wall.get_Parameter(BuiltInParameter.WALL_USER_HEIGHT_PARAM)
            if p and not p.IsReadOnly:
                p.Set(height)
        except:
            pass

    return wall


def make_door(cmd, level):
    geom    = cmd['geometry']
    pos     = geom['position']
    sym     = find_family_symbol(BuiltInCategory.OST_Doors)
    if sym is None:
        return None
    try:
        inst = doc.Create.NewFamilyInstance(
            xyz(pos), sym, level, StructuralType.NonStructural
        )
        # Поворот
        rot = geom.get('rotation', 0.0)
        if rot and abs(rot) > 0.01:
            axis  = Line.CreateUnbound(xyz(pos), XYZ.BasisZ)
            angle = rot * math.pi / 180.0
            ElementTransformUtils.RotateElement(doc, inst.Id, axis, angle)
        return inst
    except:
        return None


def make_window(cmd, level):
    geom = cmd['geometry']
    pos  = geom['position']
    sym  = find_family_symbol(BuiltInCategory.OST_Windows)
    if sym is None:
        return None
    try:
        inst = doc.Create.NewFamilyInstance(
            xyz(pos), sym, level, StructuralType.NonStructural
        )
        rot = geom.get('rotation', 0.0)
        if rot and abs(rot) > 0.01:
            axis  = Line.CreateUnbound(xyz(pos), XYZ.BasisZ)
            angle = rot * math.pi / 180.0
            ElementTransformUtils.RotateElement(doc, inst.Id, axis, angle)
        return inst
    except:
        return None


def make_stair_placeholder(cmd, level):
    """Лестница пока как Generic Model по bbox."""
    geom = cmd['geometry']
    pts  = geom.get('points', [])
    if len(pts) < 2:
        return None
    sym = find_family_symbol(BuiltInCategory.OST_GenericModel)
    if sym is None:
        return None
    # Центр bbox как точка вставки
    bbox = geom.get('bbox', {})
    cx = (bbox.get('min_x', 0) + bbox.get('max_x', 0)) / 2
    cy = (bbox.get('min_y', 0) + bbox.get('max_y', 0)) / 2
    try:
        return doc.Create.NewFamilyInstance(
            XYZ(cx, cy, 0), sym, level, StructuralType.NonStructural
        )
    except:
        return None


# --- Основной цикл ---

level = get_level(level_name)
if level is None:
    OUT = f'ERROR: Уровень "{level_name}" не найден'
    raise Exception(OUT)

results  = []
errors   = []
placed   = 0
skipped  = 0

TransactionManager.Instance.EnsureInTransaction(doc)

for json_file in json_files:
    path = os.path.join(json_folder, json_file)
    try:
        with open(path, 'r', encoding='utf-8') as f:
            data = json.load(f)
    except Exception as e:
        errors.append(f'Ошибка чтения {json_file}: {e}')
        continue

    commands    = data.get('commands', [])
    file_ok     = 0
    file_skip   = 0

    for cmd in commands:
        try:
            method  = cmd.get('method')
            element = None

            if method == 'wall':
                element = make_wall(cmd, level)
            elif method == 'door':
                element = make_door(cmd, level)
            elif method == 'window':
                element = make_window(cmd, level)
            elif method == 'stair':
                element = make_stair_placeholder(cmd, level)

            if element is not None:
                file_ok += 1
            else:
                file_skip += 1

        except Exception as e:
            errors.append(f"{cmd.get('id','?')}: {e}")
            file_skip += 1

    placed  += file_ok
    skipped += file_skip
    results.append(f'{json_file}: OK={file_ok} SKIP={file_skip}')

TransactionManager.Instance.TransactionTaskDone()

# --- Итог ---
lines = [
    '=== GenerateRevit завершён ===',
    f'Уровень:          {level_name}',
    f'Файлов:           {len(json_files)}',
    f'Размещено:        {placed}',
    f'Пропущено:        {skipped}',
    '',
] + results

if errors:
    lines += ['', '--- Ошибки (первые 20) ---'] + errors[:20]

OUT = chr(10).join(lines)
# ----------------------------------------
путь_к_revit_commands = CodeBlock()  # graph input
# ---------- путь_к_revit_commands.designscript (3 lines) ----------
// Путь к папке revit_commands
// Измени на свой путь
r"C:\Users\Acer\Desktop\Севкав\Generation3DFrom2DLib_06\data\processed\revit_commands";
# ----------------------------------------
имя_уровня = CodeBlock { "Level 1"; }  # graph input
